# Dynamo graph Place Life Safty Dampers_Data Exchange.dyn (Dynamo 2.17.0.3472)
# author: Sean Fruin
# Place life safty dampers at fire rated wall the are brought in with a Autodesk Data Exchange.
# packages: DynamoATF 2.13.0, MEPover 2022.10.30

# group: 1️⃣ Data Exchange Data Collection
get_exchange = DataExchange(workspace="D:\02-Marketing\03-Conferences\03-In the Works\AU - 2023\Dyanmo\Place Life Safty Dampers_Data Exchange.dyn", FlagForCreateOrReadExchange="ReadOnly")
receive = ReceiveExchangeData(exchange=get_exchange, SelectedUnit="Foot")
toGeometries = DXTranslation.DXData.ToGeometries()  # unwired: dXData

# group: 3️⃣ Duct Data Collection
duct_dictionary = CodeBlock()
# ---------- duct_dictionary.designscript (35 lines) ----------
def dictionray_DuctData(systemElements:var[])
{
//Get And Set Parameter Values
elements_ = DSCore.List.Flatten(systemElements);
parNames = ["Size","Slope","Reference Level","Top Elevation",
            "Bottom Elevation","Category"];
 parValues = elements_<1>.GetParameterValueByName(parNames<2>);
  αDic = Dictionary.ByKeysValues(parNames,parValues@L2<1>);

//Get And Set Dimension Parameters And Convert To Feet
dimNames =
	["Outside Diameter","Diameter","Width","Height","Insulation Thickness"];
 dimValues = elements_<1>.GetParameterValueByName(dimNames<2>)/12;
  βDic = Dictionary.SetValueAtKeys(αDic<1>,dimNames,dimValues@L2<1>);

//Get Geometric Parameters
curve = Revit.Element.GetLocation(elements_);
solid = List.Flatten(Revit.Element.Solids(elements_),-1);

//Get Shape
size = βDic["Size"];
shape = βDic["Category"].Name == "Pipes"      ?"round":
        DSCore.String.Contains(size,"x",false)?"rectangle":
        DSCore.String.Contains(size,"/",false)?"oval":"round";

//Get And Set System Type
syName=Revit.Element.Name(elements_.GetParameterValueByName("System Type"))+"";
 sysType = syName<1><2>!=null?syName:"undefined";

//Set Dictionary
geoNames = ["element","curve","solid","shape","System Type"];
geoValues =   List.Transpose([elements_,curve,solid,shape,sysType]);
γDic = Dictionary.SetValueAtKeys(βDic<1>,geoNames,geoValues@L2<1>);
return=γDic;
};
# ----------------------------------------
code_block = CodeBlock { Revit.Category.ByName("Ducts"); }
all_elements_of_category = ElementsOfCategory(Category=code_block)
code_block_2 = CodeBlock(systemElements=all_elements_of_category) { dictionray_DuctData(systemElements); }

family_types = FamilyTypes()  # nothing selected; graph input

# group: 2️⃣ Clean Data
clean_wall_geometry = CodeBlock(damperFamily=family_types, geometry_DX=toGeometries)
# ---------- clean_wall_geometry.designscript (7 lines) ----------
damperFamily;

geometry = List.Clean(geometry_DX,false);
typeName = DSCore.Object.Type(geometry);
bool_type = String.Contains(typeName, "Solid",false);
geometry2 = List.FilterByBoolMask(geometry,bool_type)["in"];
wall_solids = Solid.ByUnion(List.Clean(geometry2,false));
# ----------------------------------------

# group: 4️⃣ Intersection Calculation
clash_fuctions = CodeBlock(damperFamily=clean_wall_geometry.damperFamily, wall_solids=clean_wall_geometry.wall_solids, sysDic=code_block_2)
# ---------- clash_fuctions.designscript (17 lines) ----------
damperFamily;
wall_solids;
sysDic;
//Intersection Pairing
intersectTest = Geometry.DoesIntersect(sysDic["curve"]<1>,wall_solids<2>);
 sysCnt = List.CountTrue(intersectTest<1>);
 i_arch = List.AllIndicesOf(intersectTest<1L>,true);
  sysDic_clash = List.Flatten(List.OfRepeatedItem(sysDic<1>,sysCnt<1>),-1);

clas_Solid = List.Clean(List.GetItemAtIndex(wall_solids,i_arch),false);
intersect_Crv = List.Flatten(Geometry.Intersect(clas_Solid,sysDic_clash["curve"]));

//Get Damper Placment Point
placmentPt = intersect_Crv.PointAtParameter(0.5);


damperFamily;
# ----------------------------------------

# group: 6️⃣ Place Damper
code_block_3 = CodeBlock(sysDic_clash=clash_fuctions.out6) { sysDic_clash["element"]; }
code_block_4 = CodeBlock(placmentPt=clash_fuctions.out9) { List.Chop(placmentPt,1); }
byPointsAndCurve = Custom[MEPFitting.ByPointsAndCurve](MEPCurve=code_block_3, ListOfPoints=code_block_4, MEPFitting=clash_fuctions.out10, lacing=Shortest)  # package MEPover
