# Dynamo graph Room Data Create Data Exchange_v24.1.dyn (Dynamo 2.18.1.5096)
# author: Sean Fruin
# This script expertly classifies Spaces into HVAC Zones for terminal equipment based on Space parameters and the user's provided specification.
# packages: ForgeParameterNodes 2.17.2.0, DynamoATF 2.13.0

# group: 1️⃣ Select Phase
# note: Select the phase you would   ➡️
# like to use for Data Exchange
select_phase = RevitPhases("New Construction")

# group: 2️⃣ Get Rooms
# note: This section collects all of the Rooms in the Revit project.
n2_1_collect_element_tiggers = CodeBlock { c = Category.ByName("Rooms"); }  # "2.1 Collect Element Tiggers"
all_elements_of_category = ElementsOfCategory(Category=n2_1_collect_element_tiggers)

# group: 3️⃣ Room Dictionaries
# note: This section creates a dictionary with parameters and collects solid geometry for all placed Rooms of a specified Phase.
n3_1_room_data = CodeBlock(uiPhase=select_phase, rooms=all_elements_of_category)  # "3.1 Room Data"
# ---------- n3_1_room_data.designscript (16 lines) ----------
//Get Rooms That Match Specifed Phase
boolPhase = uiPhase.Name == rooms.GetParameterValueByName("Phase").Name;
rooms1 = List.FilterByBoolMask(rooms,boolPhase)["in"];

//Remove Outdoor Rooms
roomOcc = rooms1.GetParameterValueByName("Occupancy");
boolOutdoor = String.Contains(roomOcc,"Outdoor",true);
rooms2 = List.FilterByBoolMask(rooms1,boolOutdoor)["out"];

//Remove Space With No Solid Geometry
bool_solid = List.IsEmpty(Element.Solids(rooms2)<1L>);
rooms3 = List.FilterByBoolMask(rooms2,bool_solid)["out"];

//Get Data Exchange Data
solid = Solid.ByUnion(Element.Solids(rooms3));
roomDics = roomDictionary(rooms3);
# ----------------------------------------
watch = Watch(n3_1_room_data.roomDics)
definition_room_dictionary = CodeBlock()
# ---------- definition_room_dictionary.designscript (26 lines) ----------
def roomDictionary(room:var)
{
//Get Parameter Values
name = Room.Name(room);
number = Room.Number(room);
level = room.GetParameterValueByName("Level");
area = room.GetParameterValueByName("Area");
volume = room.GetParameterValueByName("Volume");
finish_base = room.GetParameterValueByName("Base Finish");
finish_ceiling = room.GetParameterValueByName("Ceiling Finish");
finish_floors = room.GetParameterValueByName("Floor Finish");
finish_walls = room.GetParameterValueByName("Wall Finish");
occupancy = room.GetParameterValueByName("Occupancy");
occupant = room.GetParameterValueByName("Occupant");
perimeter = room.GetParameterValueByName("Perimeter");

//Space Dictionary
keys =
["room name","number","level","area","Volume","finish base","finish ceiling",
 "finish floors","finish walls","occupancy","occupant","perimeter"];
values = List.Clean(
[name,number,level,area,volume,finish_base,finish_ceiling,
 finish_floors,finish_walls,occupancy,occupant,perimeter],true);

return = Dictionary.ByKeysValues(keys,values);
};
# ----------------------------------------

# group: 4️⃣ Generate Data Parameters
# note: This section of the graph converts the Room parameters to Data Exchage "Data Parameters" .
n4_1_data_parameter_inputs = CodeBlock(dictionary=watch)  # "4.1 Data Parameter Inputs"
# ---------- n4_1_data_parameter_inputs.designscript (7 lines) ----------
keys =
Dictionary.Keys(dictionary)[0];
spec_Description();
spec_List();

values =
List.Transpose(Dictionary.Values(dictionary));
# ----------------------------------------
createParameterType = ForgeParameterNodes.DataParameters.DataParameter.CreateParameterType(name=n4_1_data_parameter_inputs.keys, description=n4_1_data_parameter_inputs.out1, spec=n4_1_data_parameter_inputs.out2, lacing=Longest)
byParameterTypeIdValue = ForgeParameterNodes.DataParameters.DataParameter.ByParameterTypeIdValue(typeId=createParameterType, value=n4_1_data_parameter_inputs.values)
transpose = List.Transpose(lists=byParameterTypeIdValue)
watch_2 = Watch(transpose)
function_spec_type_list = CodeBlock()
# ---------- function_spec_type_list.designscript (17 lines) ----------
def spec_List()
{
//Get Spec Types Ids
return = Spec.BySpecTypeId(
["autodesk.spec:spec.string-2.0.0",
 "autodesk.spec:spec.string-2.0.0",
 "autodesk.spec:spec.string-2.0.0",
 "autodesk.spec:spec.string-2.0.0",
 "autodesk.spec.aec:volume-2.0.0",
 "autodesk.spec:spec.string-2.0.0",
 "autodesk.spec:spec.string-2.0.0",
 "autodesk.spec:spec.string-2.0.0",
 "autodesk.spec.aec:area-2.0.0",
 "autodesk.spec.aec:length-2.0.0",
 "autodesk.spec:spec.string-2.0.0",
 "autodesk.spec:spec.string-2.0.0"]);
 };
# ----------------------------------------
function_spec_description = CodeBlock()
# ---------- function_spec_description.designscript (17 lines) ----------
def spec_Description()
{
//Parameter Description
return =
["The number of the Room",
 "The occupant description of the Room",
 "The Specified finish of the Room's base",
 "The Specified finish of the Room's floor",
 "The volume of the Room",
 "The name of the Room",
 "The Specified finish of the Room's ceiling",
 "The occupant description of the Room",
 "The area of the Room",
 "The perimeter of the Room",
 "The level the Room is hosted on",
 "The Specified finish of the Room's walls"];
 };
# ----------------------------------------

# group: 5️⃣ Data Exchanges
# note: ⬅️ Create a Data Exchange
get_exchange = DataExchange(workspace="D:\02-Marketing\03-Conferences\03-In the Works\AU - 2023\Dyanmo\Room Data Create Data Exchange_v24.1.dyn", FlagForCreateOrReadExchange="WriteOnly")
# note: This section of the graph creates the Data Exchanges with the Room geometry and parameters.
by_geometries_and_parameters = DxDataUI(Geometries=n3_1_room_data.solid, Parameters=watch_2)  # graph output
# note: ⬇️ Click Send once Data Exchange is created
send = SendExchangeData(exchange=get_exchange, dXData=by_geometries_and_parameters, SelectedUnit="Foot")

code_block = CodeBlock(solids=n3_1_room_data.solid) { solids; }
