# Dynamo graph Space Data Create Data Exchange_v24.1.dyn (Dynamo 2.18.1.5096)
# author: Sean Fruin
# This script expertly classifies Spaces into HVAC Zones for terminal equipment based on Space parameters and the user's provided specification.
# packages: ForgeParameterNodes 2.17.2.0, DynamoATF 2.13.0

# group: 1️⃣ Select Phase
# note: Select the phase you would   ➡️
# like to use for Data Exchange
select_phase = RevitPhases("New Construction")

# group: 2️⃣ Get Spaces
# note: This section collects all of the Spaces in the Revit project.
n2_1_collect_element_tiggers = CodeBlock { c = Category.ByName("Spaces"); }  # "2.1 Collect Element Tiggers"
all_elements_of_category = ElementsOfCategory(Category=n2_1_collect_element_tiggers)

# group: 3️⃣ Space Dictionaries
# note: This section creates a dictionary with parameters and collects solid geometry for all spaces of a specified Phase.
n3_1_space_data = CodeBlock(uiPhase=select_phase, spaces=all_elements_of_category)  # "3.1 Space Data"
# ---------- n3_1_space_data.designscript (11 lines) ----------
//Get Spaces That Match Specifed Phase
boolPhase = uiPhase.Name == spaces.GetParameterValueByName("Phase").Name;
spcs1 = List.FilterByBoolMask(spaces,boolPhase)["in"];

//Remove Space With No Solid Geometry
bool_solid = List.IsEmpty(Element.Solids(spcs1)<1L>);
spcs2 = List.FilterByBoolMask(spcs1,bool_solid)["out"];

//Get Data Exchange Data
solid = Solid.ByUnion(Element.Solids(spcs2));
spcDics = spaceDictionary(spcs2);
# ----------------------------------------
watch = Watch(n3_1_space_data.spcDics)
definition_space_dictionary = CodeBlock()
# ---------- definition_space_dictionary.designscript (21 lines) ----------
def spaceDictionary(space:var)
{
//Get Parameter Values
name = Space.Name(space);
number = Space.Number(space);
level = space.GetParameterValueByName("Level");
area = space.GetParameterValueByName("Area");
volume = space.GetParameterValueByName("Volume");
cool_load = space.GetParameterValueByName("Design Cooling Load");
heat_load = space.GetParameterValueByName("Design Heating Load");
SA = space.GetParameterValueByName("Specified Supply Airflow");

//Space Dictionary
keys =
["name","number","level","area","Volume",
 "cooling load","heating load","supply air"];
values = List.Clean(
[name,number,level,area,volume,cool_load,heat_load,SA],true);

return = Dictionary.ByKeysValues(keys,values);
};
# ----------------------------------------

# group: 4️⃣ Generate Data Parameters
# note: This section of the graph converts the Space parameters to Data Exchage "Data Parameters" .
code_block = CodeBlock(dictionary=watch)
# ---------- code_block.designscript (7 lines) ----------
keys =
Dictionary.Keys(dictionary)[0];
spec_Description();
spec_List();

values =
List.Transpose(Dictionary.Values(dictionary));
# ----------------------------------------
createParameterType = ForgeParameterNodes.DataParameters.DataParameter.CreateParameterType(name=code_block.keys, description=code_block.out1, spec=code_block.out2, lacing=Longest)
byParameterTypeIdValue = ForgeParameterNodes.DataParameters.DataParameter.ByParameterTypeIdValue(typeId=createParameterType, value=code_block.values)
transpose = List.Transpose(lists=byParameterTypeIdValue)
watch_2 = Watch(transpose)
code_block_2 = CodeBlock()
# ---------- code_block_2.designscript (13 lines) ----------
def spec_List()
{
//Get Spec Types Ids
return = Spec.BySpecTypeId(
["autodesk.spec:spec.string-2.0.0",
 "autodesk.spec:spec.string-2.0.0",
 "autodesk.spec.aec.hvac:airFlow-2.0.0",
 "autodesk.spec.aec:volume-2.0.0",
 "autodesk.spec.aec:area-2.0.0",
 "autodesk.spec.aec.hvac:coolingLoad-2.0.0",
 "autodesk.spec.aec.hvac:heatingLoad-2.0.0",
 "autodesk.spec:spec.string-2.0.0"]);
 };
# ----------------------------------------
code_block_3 = CodeBlock()
# ---------- code_block_3.designscript (13 lines) ----------
def spec_Description()
{
//Parameter Description
return =
["The number of the Space",
 "The name of the Space",
 "The Specified Supply Air assigned to the space",
 "The volume of the Space",
 "The area of the Space",
 "The peak cooling load assigned to the Space",
 "The peak heating load assigned to the Space",
 "The level the space is hosted on"];
 };
# ----------------------------------------

# group: 5️⃣ Data Exchanges
# note: ⬅️ Create a Data Exchange
get_exchange = DataExchange(workspace="D:\02-Marketing\03-Conferences\03-In the Works\AU - 2023\Dyanmo\Space Data Create Data Exchange_v24.1.dyn", FlagForCreateOrReadExchange="WriteOnly")
# note: This section of the graph creates the Data Exchanges with the Space geometry and parameters.
by_geometries_and_parameters = DxDataUI(Geometries=n3_1_space_data.solid, Parameters=watch_2)  # graph output; frozen
# note: ⬇️ Click Send once Data Exchange is created
send = SendExchangeData(exchange=get_exchange, dXData=by_geometries_and_parameters, SelectedUnit="Foot")
